# Dynamo graph modelcleanup.dyn (Dynamo 2.0.3.8810)

# group: USER INPUTS
# note: USED:
# FOR USER SELECTIONS, SETTINGS AND GRAPH VARIABLES

# group: CREATE IN REVIT
# note: USED:
# FOR THE CREATION OF ELEMENTS IN THE REVIT WORKSPACE

# group: GET DATA
# note: USED:
# FOR THE DISCOVERY AND RETRIVAL OF INFORMATION

# group: WRITE DATA
# note: USED:
# FOR INSTANCES WHICH CREATE  AND EXPORT DATA TO REVIT OR EXTERNAL SOFTWARES/DIRECTORIES

# group: GRAPH PROCESS COLOR CODING
# note: DYNAMO GRAPHIC STANDARDS APPLIED

# group: CREATE IN DYNAMO
# note: USED:
# IN CREATION OR ADAPTATION OF GEOMETRY IN THE DYNAMO WORKSPACE

# group: PROCESS DATA
# note: USED:
# AS A GENERAL DEFINITION FOR CASES OF DATA PROCESSING

# group: Usage Notes
# note: Script Version: 1.2
# Dynamo Version: 2.0.2+
# Author: Paul Fassnidge
# Date: 26/02/20
# Contact: paulfassnidge@hydrock.com
# Released Notes:
# Fix double dash in Sheet Number due to no Role Parameter
# Packages Used:
# Data-Shapes version: 2019.2.42
# Archilab 20.23.3
# Instructions:
# IMPORTANT - FOR BEST PERFORMANCE in REVIT 2018 + RUN OFF DYNAMO PLAYER ONLY.
# YOU WILL STILL NEED TO PURGE THE MODEL AND REMOVE ANY UNUSED FAMILIES AFTER SCRIPT RUN
# 1) Run the script and check boxes for elements to deleted from the model. Remember all elements from each category will be deleted or unloaded
# 2) Press Run in Manual mode

# group: UI Select +
code_block = CodeBlock { "BPE Model Purge Tool"; }
file_path = Filename("..\..\..\OneDrive - Hydrock Consultants Ltd\BPE_Labs\bpe_labs.jpg")
code_block_2 = CodeBlock { "Delete (Are you sure?!)"; }
code_block_3 = CodeBlock { "What do you want to Purge from the Model? Please make sure this is the right model and you have sync'd to Central first!"; }
code_block_4 = CodeBlock { false; }
code_block_5 = CodeBlock { "Views and Sheets"; }
data_shapes_ui_boolean_input = Custom[Data-Shapes_UI.Boolean input](InputName=code_block_3, DefaultValue=code_block_4, SideText=code_block_5)  # Creates a boolean input for UI.MultipleInputForm ++ . Check out www.data-shapes.net for more infos!
code_block_6 = CodeBlock { false; }
code_block_7 = CodeBlock { "Schedules"; }
data_shapes_ui_boolean_input_2 = Custom[Data-Shapes_UI.Boolean input](DefaultValue=code_block_6, SideText=code_block_7)
code_block_8 = CodeBlock { false; }
code_block_9 = CodeBlock { "Links"; }
data_shapes_ui_boolean_input_3 = Custom[Data-Shapes_UI.Boolean input](DefaultValue=code_block_8, SideText=code_block_9)
list_create = List.Create(item0=data_shapes_ui_boolean_input, item1=data_shapes_ui_boolean_input_2, item2=data_shapes_ui_boolean_input_3)
code_block_10 = CodeBlock { true; }
code_block_11 = CodeBlock { "Cancel"; }
code_block_12 = CodeBlock { 800; }
data_shapes_ui_multipleinputform = Custom[Data-Shapes_UI.MultipleInputForm ++](Description_optional=code_block, Logo_optional=file_path, ButtonText_optional=code_block_2, Inputs=list_create, Toggle=code_block_10, CancelButtonText_optional=code_block_11, MaxHeight_optional=code_block_12, Width_optional=code_block_12)  # Create a form with multiple inputs. see www.data-shapes.net for tutorials and infos!

# group: Sort data
code_block_13 = CodeBlock { 2; }
getItemAtIndex = List.GetItemAtIndex(list=data_shapes_ui_multipleinputform.User_Inputs, index=code_block_13)
code_block_14 = CodeBlock { 1; }
getItemAtIndex_2 = List.GetItemAtIndex(list=data_shapes_ui_multipleinputform.User_Inputs, index=code_block_14)
code_block_15 = CodeBlock { 0; }
getItemAtIndex_3 = List.GetItemAtIndex(list=data_shapes_ui_multipleinputform.User_Inputs, index=code_block_15)

get_document = Python()
# ---------- get_document.python (29 lines) ----------
# Copyright(c) 2015, Konrad K Sobon
# @arch_laboratory, http://archi-lab.net

# Import DocumentManager
import clr
clr.AddReference("RevitServices")
import RevitServices
from RevitServices.Persistence import DocumentManager

import sys
pyt_path = r'C:\Program Files (x86)\IronPython 2.7\Lib'
sys.path.append(pyt_path)

#The inputs to this node will be stored as a list in the IN variable.
dataEnteringNode = IN

try:
	errorReport = None
	doc = DocumentManager.Instance.CurrentDBDocument
except:
	# if error accurs anywhere in the process catch it
	import traceback
	errorReport = traceback.format_exc()

#Assign your output to the OUT variable
if errorReport == None:
	OUT = doc
else:
	OUT = errorReport
# ----------------------------------------
get_all_views_sheets = Python(IN[0]=get_document)
# ---------- get_all_views_sheets.python (24 lines) ----------
import clr
clr.AddReference('RevitAPI')
from Autodesk.Revit.DB import *
import Autodesk

clr.AddReference("RevitServices")
import RevitServices
from RevitServices.Persistence import DocumentManager

inputdoc = UnwrapElement(IN[0])
if inputdoc == None:
	doc = DocumentManager.Instance.CurrentDBDocument
elif inputdoc.GetType().ToString() == "Autodesk.Revit.DB.RevitLinkInstance":
	doc = inputdoc.GetLinkDocument()
elif inputdoc.GetType().ToString() == "Autodesk.Revit.DB.Document":
	doc = inputdoc
else: doc = None

collector = FilteredElementCollector(doc)
views = collector.OfClass(View).ToElements()
viewlist = list()
for view in views:
	viewlist.append(view)
OUT = viewlist
# ----------------------------------------
flatten = List.Flatten(list=get_all_views_sheets)

# group: Get Revit Items
getDocuments = archilab.Revit.Selection.Select.GetDocuments()
code_block_16 = CodeBlock(link=getDocuments.Link_Doc) { link; }
code_block_17 = CodeBlock { false; }
get_project_documents = Python()  # graph input
# ---------- get_project_documents.python (100 lines) ----------
#Copyright(c) 2015, Konrad Sobon
# @arch_laboratory, http://archi-lab.net

import clr
clr.AddReference('ProtoGeometry')
from Autodesk.DesignScript.Geometry import *

# Import DocumentManager and TransactionManager
clr.AddReference("RevitServices")
import RevitServices
from RevitServices.Persistence import DocumentManager
from RevitServices.Transactions import TransactionManager

# Import RevitAPI
clr.AddReference("RevitAPI")
import Autodesk
from Autodesk.Revit.DB import *

doc = DocumentManager.Instance.CurrentDBDocument
uiapp = DocumentManager.Instance.CurrentUIApplication
app = uiapp.Application

from System.Collections.Generic import *

# Import ToDSType(bool) extension method
clr.AddReference("RevitNodes")
import Revit
clr.ImportExtensions(Revit.Elements)

#The inputs to this node will be stored as a list in the IN variable.
dataEnteringNode = IN

#collect all views in the model
collector = FilteredElementCollector(doc)
views = collector.OfClass(View).ToElements()

#sort views into separate lists based on view type
areaPlans, ceilingPlans, columnSchedules = [], [], []
costReport, details, draftingViews = [], [], []
drawingSheets, elevations, engineetingPlans = [], [], []
floorPlans, internal, legends, loadReports = [], [], [], []
panelSchedules, pressureLossReports, renderings = [], [], []
reports, schedules, sections, threeD = [], [], [], []
undefined, walkthrough = [], []
for i in views:
	if not i.IsTemplate:
		if i.ViewType == ViewType.AreaPlan:
			areaPlans.append(i.ToDSType(True))
		elif i.ViewType == ViewType.CeilingPlan:
			ceilingPlans.append(i.ToDSType(True))
		elif i.ViewType == ViewType.ColumnSchedule:
			columnSchedules.append(i.ToDSType(True))
		elif i.ViewType == ViewType.CostReport:
			costReport.append(i.ToDSType(True))
		elif i.ViewType == ViewType.Detail:
			details.append(i.ToDSType(True))
		elif i.ViewType == ViewType.DraftingView:
			draftingViews.append(i.ToDSType(True))
		elif i.ViewType == ViewType.DrawingSheet:
			drawingSheets.append(i.ToDSType(True))
		elif i.ViewType == ViewType.Elevation:
			elevations.append(i.ToDSType(True))
		elif i.ViewType == ViewType.EngineeringPlan:
			engineetingPlans.append(i.ToDSType(True))
		elif i.ViewType == ViewType.FloorPlan:
			floorPlans.append(i.ToDSType(True))
		elif i.ViewType == ViewType.Internal:
			internal.append(i.ToDSType(True))
		elif i.ViewType == ViewType.Legend:
			legends.append(i.ToDSType(True))
		elif i.ViewType == ViewType.LoadsReport:
			loadReports.append(i.ToDSType(True))
		elif i.ViewType == ViewType.PanelSchedule:
			panelSchedules.append(i.ToDSType(True))
		elif i.ViewType == ViewType.PresureLossReport:
			pressureLossReports.append(i.ToDSType(True))
		elif i.ViewType == ViewType.Rendering:
			renderings.append(i.ToDSType(True))
		elif i.ViewType == ViewType.Report:
			reports.append(i.ToDSType(True))
		elif i.ViewType == ViewType.Schedule:
			schedules.append(i.ToDSType(True))
		elif i.ViewType == ViewType.Section:
			sections.append(i.ToDSType(True))
		elif i.ViewType == ViewType.ThreeD:
			threeD.append(i.ToDSType(True))
		elif i.ViewType == ViewType.Undefined:
			undefined.append(i.ToDSType(True))
		elif i.ViewType == ViewType.Walkthrough:
			walkthrough.append(i.ToDSType(True))
		else:
			continue

#Assign your output to the OUT variable
OUT = areaPlans, ceilingPlans, columnSchedules, costReport, \
	details, draftingViews, drawingSheets, elevations, \
	engineetingPlans, floorPlans, internal, legends, \
	loadReports, panelSchedules, pressureLossReports, \
	renderings, reports, schedules, sections, threeD, \
	undefined, walkthrough
# ----------------------------------------
code_block_18 = CodeBlock { 17; }
getItemAtIndex_4 = List.GetItemAtIndex(list=get_project_documents, index=code_block_18)
restOfItems = List.RestOfItems(list=flatten)

# group: Check and Delete
if_ = If(test=getItemAtIndex, true=code_block_16, false=code_block_17)
unload_links = Python(IN[0]=if_)
# ---------- unload_links.python (31 lines) ----------
import clr
clr.AddReference('RevitAPI')
import Autodesk
from Autodesk.Revit.DB import *
from Autodesk.Revit.Attributes import*

clr.AddReference("RevitServices")
import RevitServices
from RevitServices.Persistence import DocumentManager
from RevitServices.Transactions import TransactionManager

clr.AddReference("RevitNodes")
import Revit
clr.ImportExtensions(Revit.Elements)


dataEnteringNode = IN

doc = DocumentManager.Instance.CurrentDBDocument

revitlinktypes=list()
linkcollector=FilteredElementCollector(doc).OfClass(RevitLinkInstance)
revitlinktypes=[]
TransactionManager.Instance.ForceCloseTransaction()
for rli in linkcollector:
	rlt=doc.GetElement(rli.GetTypeId())
	revitlinktypes.append(rlt)
	rlt.Unload(None)
	

OUT= 0
# ----------------------------------------
if_2 = If(test=getItemAtIndex_2, true=getItemAtIndex_4, false=code_block_17)
delete = archilab.Revit.Elements.Elements.Delete(element=if_2)
if_3 = If(test=getItemAtIndex_3, true=restOfItems, false=code_block_17)
delete_2 = archilab.Revit.Elements.Elements.Delete(element=if_3)

# group: Data
python_script = Python()  # unwired: IN[0]
# ---------- python_script.python (22 lines) ----------
#BPE data metrics by PF

import clr
import System
from System.IO import Directory

import sys
# load python
pyt_path = r'C:\Program Files (x86)\IronPython 2.7\Lib'
sys.path.append(pyt_path)

from datetime import datetime

project = IN[0]

# get the current date and time
starttime = datetime.now().strftime("%H-%M-%S")

import os
   

OUT = starttime
# ----------------------------------------
control = CodeBlock(passthrough=delete_2, waitfor=python_script) { [passthrough,waitfor][0]; }
python_script_2 = Python(IN[0]=control)
# ---------- python_script_2.python (35 lines) ----------
#Get project info by PF

import clr
clr.AddReference("RevitServices")
clr.AddReference('DynamoRevitDS')
import RevitServices
from RevitServices.Persistence import DocumentManager

import Dynamo 
import sys
sys.path.append(r'C:\Program Files (x86)\IronPython 2.7\Lib')

import os
DynamoRevit=Dynamo.Applications.DynamoRevit()

passthrough = IN[0]

#Get doc and dynamo stuff
doc = DocumentManager.Instance.CurrentDBDocument
app = DocumentManager.Instance.CurrentUIApplication.Application
scriptname=DynamoRevit.RevitDynamoModel.CurrentWorkspace.FileName

name=os.path.basename(scriptname)

filename,extention=os.path.splitext(name)

elementlist = list()
projinfo = doc.ProjectInformation

elementlist.append(projinfo.Name)
elementlist.append(projinfo.Number)
elementlist.append(app.Username)
elementlist.append(filename)

OUT = elementlist
# ----------------------------------------
control_2 = CodeBlock(seq=python_script_2) { seq[0]; seq[1]; seq[2]; seq[3]; }
python_script_3 = Python(IN[0]=control_2.out0, IN[1]=control_2.out1, IN[2]=control_2.out2, IN[3]=control_2.out3, IN[4]=python_script)
# ---------- python_script_3.python (42 lines) ----------
#BPE data metrics by PF

import clr
import System
from System.IO import Directory

import sys
# load python
pyt_path = r'C:\Program Files (x86)\IronPython 2.7\Lib'
sys.path.append(pyt_path)

from datetime import datetime

project = IN[0]
number = IN[1]
user = IN[2]
scriptname = IN[3]
starttime = IN[4]


# get the current date and time
datestamp = datetime.today().strftime("%Y-%m-%d")
endtime = datetime.now().strftime("%H-%M-%S")

#runtime = (endtime - starttime)
#runtime.seconds

import os

## set the output directory and gather log data
dir = 'Q:\Office\IT Software\Dynamo\data'
   
# create a directory for each user of a machine
Directory.CreateDirectory(dir)

# generate the file name for the log file
filename = (str(datestamp) + '_' +str(endtime) + '_' +str(project) + '_' +str(number) + '_' +str(scriptname) + '_' +str(starttime) + '_' +str(user) + '_' + '.txt')

# create the log file (blank text file)
logger = open(dir + '\\' + filename,'w+')

OUT = str("Run Logged")
# ----------------------------------------
